# Grasshopper definition Karamba01.gh (Grasshopper 0.9.76)
# plug-ins: Biomorpher, Karamba

number_slider = Slider(10, range=0..10)
genes = GenePool(
    Decimals=2,
    Maximum=-0.2,
    Minimum=-2,
    Value=[-1.5265146, -1.31732545, -1.507529724, -0.7134206262, -0.6750145397, -1.748098368, -1.918620741, -1.274802552, -1.88878055, -0.7867337679])
pt = ConstructPoint(XCoordinate=0, YCoordinate=0, ZCoordinate=0)
series = Series(Start=0, Step=1, Count=10)
pt_2 = ConstructPoint(XCoordinate=series, YCoordinate=0, ZCoordinate=0)
pt_3 = ConstructPoint(XCoordinate=series, YCoordinate=0, ZCoordinate=genes)
Z = UnitZ(Factor=Slider(-6.18, range=-10..0))
item = ListItem(List=reverse(pt_2), Index=0, Wrap=True)
item_2 = ListItem(List=pt_2, Index=0, Wrap=True)
pline = PolyLine(Vertices=pt_2, Closed=False)
ln = Line(StartPoint=pt_2, EndPoint=pt_3)
pline_2 = PolyLine(Vertices=pt_3, Closed=False)
loads = LoadsKaramba(ForceVector=Z, Local=True, PosInd=pt_3, LCase=0, mode="Point")
explode = Explode(Curve=pline_2, Recursive=True)  # -> Segments, Vertices
supp = SupportKaramba(PosInd=[item_2, item], menu=[buttons(on, on, on, on, on, off)])
explode_2 = Explode(Curve=pline, Recursive=True)  # -> Segments, Vertices
linetobeam = LineToBeamKaramba(Line=flatten([explode_2.Segments, ln, explode.Segments]), New=True, Remove=True, LimitDistance_m=0.005)  # -> Points, Element, Info
assemble = AssembleModelKaramba(Elem=linetobeam.Element, Support=supp, Load=loads, LimitDistance_m=0.005)  # -> Model, Info, Mass_kg, CenterOfGravity
analyzethi = AnalyzeThIKaramba(Model=assemble.Model)  # -> CalculatedModel, MaximumDisplacement_m, ResultingForceOfGravity_kN, ElasticEnergy_kNm
modelview = ModelViewKaramba(Model=analyzethi.CalculatedModel, LoadCaseFactorsForLinearSuperposition=1, IndexIncrementOfVisibleLoadcase=0)  # -> Model, DeformedMesh, DeformedAxes, DeformedModel
beamview = BeamViewKaramba(Model=modelview.Model)  # -> Model, MeshesOfRenderedBeams, DeformedBeamAxes, LegendColors, LegendTags
biomorpher = Biomorpher(Genotype=genes, Geometry=beamview.MeshesOfRenderedBeams, Performance=analyzethi.MaximumDisplacement_m)
