# Grasshopper definition boxes.gh (Grasshopper 0.9.76)
# plug-ins: Biomorpher

# In this example, genepools are used to
# create boxes which are then subtracted
# from the overall bounding box.
# 
# Double click on the Biomorpher component.
genes = GenePool(
    Decimals=2,
    Maximum=10,
    Minimum=0,
    Value=[2.275184642, 0.6580280738, 0.6106739854, 9.160326671, 5.421701934, 9.269172431, 9.996376012, 1.713502548, 5.724019239, 0.2743626787])
genes_2 = GenePool(
    Decimals=2,
    Maximum=10,
    Minimum=0,
    Value=[4.1849862, 8.442856199, 4.199702364, 6.8749362, 3.047267687, 1.912225561, 2.73886146, 8.19422802, 6.040875307, 8.126553086])
genes_3 = GenePool(
    Decimals=2,
    Maximum=10,
    Minimum=0,
    Value=[8.204189425, 4.718146689, 9.44909443, 1.577384485, 3.434223011, 8.695100315, 8.398543603, 1.439365635, 7.48452069, 9.724635133])
genes_4 = GenePool(
    Decimals=2,
    Maximum=10,
    Minimum=0,
    Value=[6.427900814, 0.8244953649, 7.516440927, 5.973810725, 9.063983535, 8.756304626, 3.602035649, 2.385159768, 1.689999741, 0.9290528993])
genes_5 = GenePool(
    Decimals=2,
    Maximum=10,
    Minimum=0,
    Value=[1.177810613, 9.30603308, 0.2622827778, 4.874501171, 4.626253718, 2.758020775, 1.773983139, 1.378938123, 3.631446681, 7.737783889])
genes_6 = GenePool(
    Decimals=2,
    Maximum=10,
    Minimum=0,
    Value=[4.438544164, 4.944203097, 8.70444727, 5.288098772, 9.125170486, 2.384841689, 8.573688007, 9.652597727, 2.162756209, 6.758794523])
dom = ConstructDomain(DomainStart=genes_5, DomainEnd=genes_6)
dom_2 = ConstructDomain(DomainStart=genes_3, DomainEnd=genes_4)
dom_3 = ConstructDomain(DomainStart=genes, DomainEnd=genes_2)
box = DomainBox(Base=PlaneXY(0, 0, 0), X=dom_3, Y=dom_2, Z=dom)
bbox = BoundingBox(Content=box, Plane=PlaneXY(0, 0, 0), UnionBox=True)  # -> Box, Box_2
volume = Volume(Geometry=bbox.Box)  # -> Volume, Centroid
scale = Scale(Geometry=bbox.Box, Center=volume.Centroid, Factor="0.9")  # -> Geometry, Transform
number_slider = Slider(191, range=0..254)
number_slider_2 = Slider(91, range=0..254)
number_slider_3 = Slider(121, range=0..254)
rgb = ColourRGB(Alpha=255, Red=number_slider, Green=number_slider_2, Blue=number_slider_3)
sdiff = SolidDifference(BrepsA=scale.Geometry, BrepsB=box)
mcol = MeshColours(Mesh=sdiff, Colours=rgb)
preview = CustomPreview(Geometry=sdiff, Shader=rgb)
biomorpher = Biomorpher(
    Genome=[number_slider_3, number_slider_2, number_slider, genes, genes_2, genes_3, genes_4, genes_5, genes_6],
    Geometry=mcol)
