# Grasshopper definition genepools.gh (Grasshopper 0.9.76)
# plug-ins: Biomorpher

genes = GenePool(
    Decimals=2,
    Maximum=100,
    Minimum=0,
    Value=[50.35767152, 34.10500345, 72.64327955, 94.38637155, 5.259252109, 35.17006488, 68.49026497, 87.89986707, 57.22823993, 24.343661])
genes_2 = GenePool(
    Decimals=2,
    Maximum=100,
    Minimum=0,
    Value=[66.77880546, 34.99463384, 15.42906888, 69.04827839, 29.46572375, 52.11625367, 57.39879122, 61.00768077, 38.19326346, 95.29913314])
pt = ConstructPoint(XCoordinate=genes_2, YCoordinate=genes, ZCoordinate=0)
msphereex = MeshSphereEx(Base=pt, Radius=10, Count=5)
biomorpher = Biomorpher(Sliders=[genes_2, genes], Geometry=msphereex)
