# Grasshopper definition BooleanBoxes.gh (Grasshopper 0.9.76)
# plug-ins: Biomorpher, MeshEdit Components

# In this example, genepools are used to create boxes which are then subtracted
# from the overall bounding box. Double click on the Biomorpher component.
genes = GenePool(
    Decimals=2,
    Maximum=10,
    Minimum=0,
    Value=[5.986614696, 9.253834695, 8.533056606, 1.217989377, 2.674555822, 4.478530965, 2.47699082, 2.201220082, 1.542195953, 6.424488056])
genes_2 = GenePool(
    Decimals=2,
    Maximum=10,
    Minimum=0,
    Value=[6.676428652, 1.051788084, 4.366124656, 0.9122670167, 3.876038414, 8.878459138, 3.377642894, 4.718770722, 4.723521818, 0.5936924092])
genes_3 = GenePool(
    Decimals=2,
    Maximum=10,
    Minimum=0,
    Value=[7.023077722, 9.968740307, 4.571499673, 7.339614847, 7.37597084, 6.581046966, 1.179618827, 8.821308216, 2.203081573, 0.5660846739])
genes_4 = GenePool(
    Decimals=2,
    Maximum=10,
    Minimum=0,
    Value=[1.925827568, 8.641179646, 0.6614813212, 4.919562435, 3.157701671, 5.19286975, 7.813661181, 7.845667134, 0.3416839476, 7.432968224])
genes_5 = GenePool(
    Decimals=2,
    Maximum=10,
    Minimum=0,
    Value=[3.730071626, 7.524868049, 5.184177889, 9.43675742, 0.5850371675, 4.444751527, 0.8572036451, 4.700715125, 7.841249983, 6.41054191])
genes_6 = GenePool(
    Decimals=2,
    Maximum=10,
    Minimum=0,
    Value=[7.842453033, 3.718362252, 8.788834582, 2.856589073, 7.202887129, 6.017874389, 4.682335022, 1.193441758, 3.842018537, 6.093508855])
dom = ConstructDomain(DomainStart=genes_5, DomainEnd=genes_6)
dom_2 = ConstructDomain(DomainStart=genes_3, DomainEnd=genes_4)
dom_3 = ConstructDomain(DomainStart=genes, DomainEnd=genes_2)
box = DomainBox(Base=PlaneXY(0, 0, 0), X=dom_3, Y=dom_2, Z=dom)
bbox = BoundingBox(Content=box, Plane=PlaneXY(0, 0, 0), UnionBox=True)  # -> Box, Box_2
volume = Volume(Geometry=bbox.Box)  # -> Volume, Centroid
scale = Scale(Geometry=bbox.Box, Center=volume.Centroid, Factor="0.9")  # -> Geometry, Transform
number_slider = Slider(89, range=0..254)
number_slider_2 = Slider(88, range=0..254)
number_slider_3 = Slider(107, range=0..254)
sdiff = SolidDifference(BrepsA=scale.Geometry, BrepsB=box)
rgb = ColourRGB(Alpha=255, Red=number_slider, Green=number_slider_2, Blue=number_slider_3)
mesh = MeshBrep(
    Brep=sdiff,
    Settings={GridMaxCount=0, GridMinCount=16, JaggedSeams=False, MaxEdgeLength=0, MinEdgeLength=0.0001, MinTolerance=0, Refine=True, RefineAngle=0, RelativeTolerance=0.65, SimplePlanes=True, Tolerance=0})
mcol = MeshColours(Mesh=mesh, Colours=rgb)
volume_2 = MeshVolume(Mesh=mcol)  # -> Volume, Centroid
biomorpher = Biomorpher(
    Genome=[number_slider, number_slider_2, number_slider_3, genes, genes_2, genes_3, genes_4, genes_5, genes_6],
    Geometry=mcol,
    Performance=volume_2.Volume)  # -> GenoGuids, Population, Historic, Clusters

# ---- group: Internalise these to store data
id = Guid()
num = Number()
num_2 = Number()

# ---- group: Visualise Cluster Distribution
viewer = ParamViewer()

# ---- group: Biomorpher Reader component
biomorpherreader = BiomorpherReader(DesignID=Slider(38, range=0..99))
