# Grasshopper definition QuadtreeExtrusions.gh (Grasshopper 1.0.7)
# plug-ins: MeshEdit Components, Biomorpher

genes = GenePool(
    Decimals=2,
    Maximum=100,
    Minimum=0,
    Value=[1.06393057, 70.02258057, 89.61437554, 84.01017188, 47.83984504, 38.64864136, 63.65868601, 91.42189524, 56.88560286, 52.16086379, 59.45742995, 36.94775791, 77.78939827, 86.84198916, 7.736612953, 37.43052927, 29.5294332, 86.81993125, 16.04784043, 53.78629642])
genes_2 = GenePool(
    Decimals=2,
    Maximum=50,
    Minimum=0,
    Value=[20.05435346, 8.409783737, 40.746985, 2.942592, 2.967249673, 37.05548369, 43.81830035, 2.333645803, 9.709937642, 18.02491265, 14.77113367, 37.69825883, 4.546724541, 25.5795387, 12.08740674, 0.88800001, 23.49385664, 39.36736816, 21.57937604, 36.96220435])
genes_3 = GenePool(
    Decimals=2,
    Maximum=100,
    Minimum=0,
    Value=[92.33558159, 90.95831355, 35.08466204, 30.17179208, 33.3169378, 26.90889888, 40.38949117, 49.23153406, 40.81008562, 77.66062281, 98.50419182, 57.42956291, 39.62358313, 25.71576667, 40.94673397, 79.59626218, 66.55952989, 44.89671436, 27.31675814, 73.70921419])
pt = ConstructPoint(XCoordinate=genes_3, YCoordinate=genes, ZCoordinate=0)
qt = QuadTree(Points=pt, Plane=PlaneXY(0, 0, 0), Square=False, Group=Slider(1, range=0..10))  # -> Quads, Points
runion = RegionUnion(Curves=qt.Quads)
# Modelling
fillet = Fillet(Curve=runion, Radius=Slider(2, range=0..10))
lng = ListLength(List=fillet)
split = SplitList(List=genes_2, Index=lng)  # -> ListA, ListB
Z = UnitZ(Factor=split.ListA)
extr = Extrude(Base=fillet, Direction=Z)
cap = CapHoles(Brep=extr)
smooth = SettingsQuality()
mesh = MeshBrep(Brep=cap, Settings=smooth)
lng_2 = ListLength(List=mesh)
random = Random(Range=Domain(0, 1), Number=lng_2, Seed=2)
random_2 = Random(Range=Domain(0, 1), Number=lng_2, Seed=3)
random_3 = Random(Range=Domain(0, 1), Number=lng_2, Seed=4)
frgb = ColourRGBF(Alpha=1, Red=random, Green=random_2, Blue=random_3)
mcol = MeshColours(Mesh=graft(mesh), Colours=graft(frgb))
preview = CustomPreview(Geometry=cap, Shader=frgb)
demesh = DeconstructMesh(Mesh=mcol)  # -> flatten(Vertices), Faces, Colours, Normals
volume = Volume(Geometry=mcol)  # -> flatten(Volume), Centroid
area = MeshArea(Mesh=mcol)  # -> flatten(Area), Centroid
# Analysis
pdecon = Deconstruct(Point=demesh.Vertices)  # -> XComponent, YComponent, ZComponent
ma = MassAddition(Input=volume.Volume)  # -> Result, PartialResults
floor_to_floor_height = Slider(3, range=0..10)
ma_2 = MassAddition(Input=area.Area)  # -> Result, PartialResults
sort = SortList(Keys=pdecon.ZComponent)  # -> reverse(Keys), ValuesA
item = ListItem(List=sort.Keys, Index=0, Wrap=True)
division = Division(A=ma_2.Result, B=ma.Result)
division_2 = Division(A=ma.Result, B=floor_to_floor_height)
peakheight_m = Number(item)
biomorpher = Biomorpher(Genome=[genes_3, genes, genes_2], Meshes=mcol, Perform=[peakheight_m, division_2, division])
