# Grasshopper definition UntangleThread.gh (Grasshopper 1.0.7)
# plug-ins: Biomorpher

# Try to untangle a thread.
# This is a very tricky problem to set an objective function
# (i.e. using Galapagos), but easier if a human can judge
# success at each generation.
# Double click on the biomorpher component to begin.
genes = GenePool(
    Decimals=2,
    Maximum=100,
    Minimum=-100,
    Value=[27.8437034, 91.59123806, 78.66520069, 69.22408006, -69.56786247, 7.72981108, 45.85876969, -83.65615714, 71.54792825, 83.4844645])
genes_2 = GenePool(
    Decimals=2,
    Maximum=100,
    Minimum=-100,
    Value=[-11.85867425, -60.16544129, -21.07059883, 33.31316262, 94.90498307, -59.88755586, -24.08274645, -88.84312965, 77.68070073, 72.66653972])
genes_3 = GenePool(
    Decimals=2,
    Maximum=100,
    Minimum=0,
    Value=[71.55442524, 26.25433988, 1.39973801, 61.79843777, 65.01063783, 64.36858831, 38.92011764, 50.7083677, 41.73704206, 18.91070336])
pt = ConstructPoint(XCoordinate=genes, YCoordinate=genes_2, ZCoordinate=genes_3)
intcrv = Interpolate(Vertices=pt, Degree=3, Periodic=True, KnotStyle=1)  # -> Curve, Length, Domain
divide = DivideCurve(Curve=intcrv.Curve, Count=Slider(100, range=0..100), Kinks=False)  # -> Points, Tangents, Parameters
curvature = Curvature(Curve=intcrv.Curve, Parameter=divide.Parameters)  # -> P, K, C
unit = UnitVector(Vector=curvature.K)
vdisex = VectorDisplayEx(Point=curvature.P, Vector=expr("x*100", curvature.K), Colour=RGB(0, 0, 0), Width=2)

# ---- group: Variance of curvature
vlen = VectorLength(Vector=curvature.K)
cluster = Cluster(num=vlen)

# ----
line = LineSDL(Start=curvature.P, Direction=unit, Length=Slider(6, range=0..10))
loft = Loft(Curves=line, Options={Adjust=False, Closed=True, LoftEnds=0, LoftSimp=0, LoftType=0, Rebuild=10, Refit=0.01})
multiplication = Multiplication(A=cluster, B=Slider(1000, range=0..1000))
preview = CustomPreview(
    Geometry=loft,
    Shader={diffuse=RGB(255, 105, 180), emission=RGB(76, 32, 54), shine=0.5, specular=RGB(255, 255, 255), transparency=0})
mesh_uv = MeshSurface(Surface=loft, UCount=200, VCount=5, Overhang=True, Equalize=False)
biomorpher = Biomorpher(Genome=[genes, genes_2, genes_3], Meshes=mesh_uv, Perform=[intcrv.Length, multiplication])

# ==== cluster Cluster
num = ClusterInput()
num_2 = Number(num)
avr = Average(Input=num_2)
subtraction = Subtraction(A=avr, B=num_2)
lng = ListLength(List=num_2)
sqr = Square(Value=subtraction)
ma = MassAddition(Input=sqr)  # -> Result, PartialResults
division = Division(A=ma.Result, B=lng)
R = ClusterOutput(division)
